vi "index.gviweb"   [G Web Development Software 22.3.0]
panel controls:
  "Exit (development only)": bool
  "Test Start": bool
  "Test Sequence": T3[]
  "Cancel": bool
panel indicators:
  "Total Duration (s)": f64
  "Step Status": T1[]
  "Program Log": string
  "Status": string
  "Initialized": bool
  "Finalized": bool
  "Graph": f64[][]
  "Result": bool
types:
  "Color.gtype" = u32
  T1 = cluster{"Progress": f64, "Result": "Color.gtype"}
  T2 = cluster{"Waveform": enum{"Constant", "Sawtooth", "Sinusoid"}, "Amplitude": f64, "Frequency": f64}
  T3 = cluster{"Duration (s)": f64, "Waveform Data": T2, "Fault Probability": f64}
  "Waveforms.gtype" = enum{"Constant", "Sawtooth", "Sinusoid"}
  "IO Data.gtype" = cluster{"Waveform": "Waveforms.gtype", "Duration (s)": f64, "Start Time": timestamp, "Time Factor": f64, "Adjusted Amplitude": f64, "New Wave": bool, "Wave Active": bool, "Fault start time": f64}
  "Step Result.gtype" = enum{"Pass", "Fail", "Canceled"}
  "Step Status.gtype" = cluster{"Progress": f64, "Result": "Step Result.gtype", "Complete": bool}
  "Waveform Data.gtype" = cluster{"Waveform": "Waveforms.gtype", "Amplitude": f64, "Frequency": f64}
  "Test Step Data.gtype" = cluster{"Duration (s)": f64, "Waveform Data": "Waveform Data.gtype", "Fault Probability": f64}
  "Manager State.gtype" = enum{"Idle", "Initialize", "Execute", "Finalize", "Cancel", "Error"}
  "Message Queue Names.gtype" = enum{"Manager", "UI", "IO"}
  "Step Data.gtype" = cluster{"Message Queue": "Message Queue Names.gtype", "Action": string}
  "Sequence.gtype" = cluster{"Manager State": "Manager State.gtype", "Steps": "Step Data.gtype"[]}
  "Manager Data.gtype" = cluster{"Current State": "Manager State.gtype", "Current Step": "Step Data.gtype", "Remaining Steps": "Step Data.gtype"[], "Remaining Sequences": "Sequence.gtype"[], "Current Instruction": string}
  "Error Data.gtype" = cluster{"Error Origin": "Message Queue Names.gtype", "Error In": error}
uses:
  WebApp::support::Message Queue::Create All Message Queues.gvi
  WebApp::support::Message Queue::Dequeue Message.gvi
  WebApp::globals.gviweb
  WebApp::Report Step Complete.gviweb
  WebApp::IO::Handle Next Waveform.gviweb
  WebApp::IO::Generate Waveform.gviweb
  WebApp::IO::Handle Hardware IO.gviweb
  WebApp::debug::Check Test Sequence Complete.gviweb
  WebApp::Generate Undefined Message Error.gviweb
  WebApp::Handle Error.gviweb
  WebApp::Define Preset Test Sequence.gviweb
  WebApp::Prep Step Staus for Display.gviweb
  WebApp::Calculate Test Duration.gviweb
  WebApp::Validate Test Sequence.gviweb
  WebApp::Handle Data Remaining in Queue.gviweb
  WebApp::Get Result Color.gviweb
  WebApp::Receive IO Data.gviweb
  WebApp::Define Program Instructions.gviweb
  WebApp::support::Message Queue::Enqueue Message (Single).gvi
  WebApp::UI messages::Append Log Text.gviweb
  WebApp::program sequences::Handle Next Sequence.gviweb
  WebApp::program sequences::Handle Next Step.gviweb
  NI::G Core::Error::Build Error Cluster.gvi
  WebApp::UI messages::Send Sequence Complete UI Updates.gviweb
  WebApp::UI messages::Update Program Status.gviweb
  WebApp::support::Error Handler - Event Handling Loop.gvi
diagram:
  w1 = bool FALSE  # Stop Event
  Create User Event[EventName="Stop Event"](user event data type=w1) -> (error out=w2, user event out=w3)
  w4 = ["Manager", "UI", "IO"]  # Queue List
  # #additional functionality
  # error fault sim
  # be able to clear error with corresponding case in IO
  # handle error from hardware during initialize or execute
  # 	be able to clear error
  # ---------------------------------
  # add finalize commands
  # 	log data
  # 		with test meta data/ description
  # 	log results
  # cancel
  # abort
  # hardware fault button
  # 	just poll in UI loop?
  # -------------------------------------------------------
  # abort
  # Display test history/ data
  # Pause
  # select between historical data
  # historical analysis/ comparison
  # Splining/ smooth transitions between waveforms
  # unit tests
  # check for empty test sequence
  # force sawtooth to return to 0 before waveform transition?
  # unit tests
  Array Size(array=w4) -> (size(s)=w5)
  call "Create All Message Queues.gvi"(Loop Count=w5, error in=w2) -> (Message Queues=w6, error out=w7)
  Obtain Queue(element data type=f64[] [], name="IO data") -> (error out=w8, queue out=w9)
  Array Index(array=w6) -> (out0["Manager"]=w10, out1["IO"]=w11)
  s1 = uninitialised  # shift register
  s2 = uninitialised  # shift register
  while {
    call "Dequeue Message.gvi"(message queue in=w11, timeout in milliseconds=0, error in=w7) -> (timed out?=w12, message queue out=w13, message=w14, message data=w15, error out=w16)
    # UI Update Loop
    case (w14) ignore case {  # Message Cases
      frame "SW Init" {
        w17 = w16
        w18 = default
        w19 = s1
        w20 = "IO Data.gtype" {all zero or empty}
      }
      frame "Initialize" {
        disable {
          frame Disabled {
            # #Integrate_Hardware
            # Hardware uninitialization goes here
            w21 = w16
          }
          frame Enabled {
            call "globals.gviweb"() -> (Globals=w22)
            Property Node(instance in=w22) -> ("Hardware Initialize Duration (s)"=w23)
            # #debug
            Multiply(w23, 1000) -> w24
            Wait(time to wait=w24)
            w21 = w16
          }
        }
        call "Report Step Complete.gviweb"(Manager Queue=w10, This Queue Name="IO", Step Name=w14, Input_3=w21) -> (Output_2=w17)
        w18 = default
        w19 = s1
        w20 = s2
      }
      frame "Finalize" {
        disable {
          frame Disabled {
            # #Integrate_Hardware
            # Hardware uninitialization goes here
            w25 = w16
          }
          frame Enabled {
            call "globals.gviweb"() -> (Globals=w26)
            Property Node(instance in=w26) -> ("Hardware Finalize Duration (s)"=w27)
            # #debug
            Multiply(w27, 1000) -> w28
            Wait(time to wait=w28)
            w25 = w16
          }
        }
        call "Report Step Complete.gviweb"(Manager Queue=w10, This Queue Name="IO", Step Name=w14, Input_3=w25) -> (Output_2=w17)
        w18 = default
        w19 = s1
        w20 = s2
      }
      frame "Execute" {
        # #todo move some of this functionality to initialization and check if test sequence is empty
        # report empty back to manager
        call "Handle Next Waveform.gviweb"(Test Sequence in=$"Test Sequence", IO Data In=s2) -> (Test Sequence out=w19, IO Data out=w20)
        w17 = w16
        w18 = default
      }
      frame "Cancel" {
        sequence {
          frame 0 {
            # Stop IO
            Property Node(instance in=s2, "Wave Active"=FALSE) -> (instance out=w20)
          }
        }
        call "Report Step Complete.gviweb"(Manager Queue=w10, This Queue Name="IO", Step Name=w14, Input_3=w16) -> (Output_2=w17)
        w18 = default
        w19 = s1
      }
      frame "Exit" {
        Release Queue(queue=w13) -> (error out=w29)
        Merge Errors(w16, w29) -> (error out=w17)
        w18 = TRUE
        w19 = s1
        w20 = s2
      }
      frame Default {
        case (w12) {
          frame True {
            Property Node(instance in=s2) -> ("Wave Active"=w30, instance out=w31)
            # No message -> handle output
            case (w30) {
              frame False, Default {
                w20 = w31
                w17 = w16
                w19 = s1
              }
              frame True {
                Property Node(instance in=w31) -> ("New Wave"=w32, instance out=w33)
                case (w32) {
                  frame False, Default {
                    w34 = w33
                  }
                  frame True {
                    Get Current Time() -> (current time=w35)
                    # only save init timestamp at wave start
                    Property Node(instance in=w33, "Start Time"=w35, "New Wave"=FALSE) -> (instance out=w34)
                  }
                }
                call "Generate Waveform.gviweb"(IO Data=w34) -> (Time Elapsed=w36, IO data out=w37, Wave Value=w38, Fraction Complete=w39)
                call "Handle Hardware IO.gviweb"(IO data in=w37, Hardware output=w38, Time Elapsed=w36) -> (IO data out=w40, Hardware input=w41)
                call "Check Test Sequence Complete.gviweb"(This Queue Name="IO", Test Sequence in=s1, IO data in=w40, Fraction Complete=w39, Manager Queue=w10) -> (Test Sequence out=w19, IO data out=w20, Fraction Complete (includes messages)=w42)
                Build Array(w42, w38, w41) -> w43
                Enqueue Element(element=w43, error in=w16, queue=w9) -> (error out=w17)
              }
            }
          }
          frame False {
            # Received message
            call "Generate Undefined Message Error.gviweb"(Queue Name="IO", Message=w14, Error in=w16) -> (Error out=w17)
            w20 = s2
            w19 = s1
          }
        }
        w18 = default
      }
    }
    call "Handle Error.gviweb"(Input=w10, Input_2="IO", Output_2=w17) -> (Output_3=w44)
    Wait(time to wait=50)
    next s1 = w19
    next s2 = w20
    stop if w18
  }
  Array Index(array=w6) -> (out0["Manager"]=w45, out1["UI"]=w46)
  Merge Errors(w7, w8) -> (error out=w47)
  s3 = uninitialised  # shift register
  s4 = uninitialised  # shift register
  s5 = uninitialised  # shift register
  s6 = uninitialised  # shift register
  s7 = uninitialised  # shift register
  s8 = uninitialised  # shift register
  while {
    call "Dequeue Message.gvi"(message queue in=w46, timeout in milliseconds=s4, error in=w47) -> (timed out?=w48, message queue out=w49, message=w50, message data=w51, error out=w52)
    # UI Update Loop
    # s8: Step Index
    # s7: Test Steps
    # s4: Dequeue Timeout
    case (w50) ignore case {  # Message Cases
      frame "SW Init" {
        Property Node(instance in=reference to "Result", "Value"=FALSE, "Text"=[" ", " "])
        Property Node(instance in=reference to "Initialized", "Value"=FALSE)
        Property Node(instance in=reference to "Finalized", "Value"=FALSE)
        Property Node(instance in=reference to "Finalized", "Value"=FALSE)
        Property Node(instance in=reference to "Test Sequence", "Disabled"=FALSE)
        Property Node(instance in=reference to "Initialized", "Value"=FALSE, error in=w52) -> (error out=w61, instance out=w62)
        Property Node(instance in=reference to "Status", "Value"="Idle", error in=w52) -> (error out=w63, instance out=w64)
        Property Node(instance in=reference to "Program Log", "Value"="", error in=w52) -> (error out=w65, instance out=w66)
        Build Array(w62, w64, w66) -> w67
        Merge Errors(w61, w63, w65) -> (error out=w68)
        s9 = w68  # shift register
        for {
          w69 = each element of w67
          Close Reference(error in=s9, reference=w69) -> (error out=w70)
          next s9 = w70
        }
        call "Define Preset Test Sequence.gviweb"() -> (Preset Test Sequence=w71)
        Array Size(array=w71) -> (size(s)=w59)
        Initialize Array(element="Step Status.gtype" {all zero or empty}, size=w59) -> w58
        call "Prep Step Staus for Display.gviweb"(Steps status out=w58) -> (Step Status=w72)
        Property Node(instance in=reference to "Step Status", "Value"=w72)
        Property Node(instance in=reference to "Test Sequence", "Value"=w71)
        call "Calculate Test Duration.gviweb"(Test Sequences=w71) -> (Total Duration (s)=w73)
        Property Node(instance in=reference to "Total Duration (s)", "Value"=w73)
        w53 = s9
        w54 = default
        w55 = ""
        w56 = -1
        w57 = f64[][] []
        w60 = 0
      }
      frame "Handle Test Change" {
        Variant To Data(error in (no error)=w52, type="Test Step Data.gtype"[] [], variant=w51) -> (data=w74, error out=w75)
        Array Size(array=w74) -> (size(s)=w59)
        call "Calculate Test Duration.gviweb"(Test Sequences=w74) -> (Total Duration (s)=w76)
        $"Total Duration (s)" <- w76
        call "Validate Test Sequence.gviweb"(Input=reference to "Test Sequence", UI Queue=w49, data=w74, error in=w75) -> (Error out=w53)
        w54 = default
        w55 = s3
        w56 = s4
        w57 = s5
        w58 = s6
        w60 = s8
      }
      frame "Execute" {
        # start polling to process data from IO loop
        call "Report Step Complete.gviweb"(Manager Queue=w45, This Queue Name="UI", Step Name=w50, Input_3=w52) -> (Output_2=w53)
        w54 = default
        w55 = s3
        w56 = 0
        w57 = s5
        w58 = s6
        w59 = s7
        w60 = s8
      }
      frame "Update Status" {
        Variant To Data(error in (no error)=w52, type=string "", variant=w51) -> (data=w77, error out=w53)
        Format Into String(formatString="%s\n%s", s3, w77) -> w55
        $"Program Log" <- w55
        w54 = default
        w56 = s4
        w57 = s5
        w58 = s6
        w59 = s7
        w60 = s8
      }
      frame "Update Program Status" {
        Variant To Data(error in (no error)=w52, type=w50, variant=w51) -> (data=w78, error out=w53)
        $Status <- w78
        w54 = default
        w55 = s3
        w56 = s4
        w57 = s5
        w58 = s6
        w59 = s7
        w60 = s8
      }
      frame "Initialize Complete" {
        $Initialized <- TRUE
        w53 = w52
        w54 = default
        w55 = s3
        w56 = s4
        w57 = s5
        w58 = s6
        w59 = s7
        w60 = s8
      }
      frame "Initialize" {
        Property Node(instance in=reference to "Result", "Value"=FALSE)
        Property Node(instance in=reference to "Test Sequence", "Disabled"=TRUE)
        Property Node(instance in=reference to "Initialized", "Value"=FALSE)
        Property Node(instance in=reference to "Finalized", "Value"=FALSE)
        # Enure at least 1 step is present
        Max And Min(x=s7, y=1) -> (max(x,y)=w79: i32)
        Initialize Array(element="Step Status.gtype" {all zero or empty}, size=w79) -> w58
        call "Prep Step Staus for Display.gviweb"(Steps status out=w58) -> (Step Status=w80)
        Property Node(instance in=reference to "Step Status", "Value"=w80, error in=w52) -> (error out=w81)
        call "Report Step Complete.gviweb"(Manager Queue=w45, This Queue Name="UI", Step Name=w50, Input_3=w81) -> (Output_2=w53)
        w54 = default
        w55 = s3
        w56 = s4
        w57 = f64[][] []
        w59 = s7
        w60 = 0
      }
      frame "Execute Complete" {
        # Handle any data remaining in queue
        call "Handle Data Remaining in Queue.gviweb"(Input_3=reference to "Graph", Input_2=reference to "Step Status", Input_4=w9, Input_5=s8, Input=s5, Input_6=s6, Input_7=w52) -> (Output=w60, Output_3=w57, Output_4=w58, Output_2=w53)
        w54 = default
        w55 = s3
        w56 = s4
        w59 = s7
      }
      frame "Finalize" {
        s10 = "Pass"  # shift register
        for {
          w82 = each element of s6
          Property Node(instance in=w82) -> ("Result"=w83)
          case (s10) {
            frame "Pass", Default {
              w84 = w83
            }
            frame "Fail" {
              case (w83) {
                frame Default {
                  w84 = w83
                }
                frame "Pass" {
                  w84 = s10
                }
              }
            }
            frame "Canceled" {
              w84 = "Canceled"
            }
          }
          next s10 = w84
        }
        call "Get Result Color.gviweb"(Input=s10) -> (Output=w85)
        Format Into String(formatString="%s", s10) -> w86
        Build Array(w86) -> w87
        # stop polling
        Property Node(instance in=reference to "Result", "TrueColor"=w85, "Text"=w87)
        $Result <- TRUE
        Property Node(instance in=reference to "Test Sequence", "Disabled"=TRUE)
        call "Report Step Complete.gviweb"(Manager Queue=w45, This Queue Name="UI", Step Name=w50, Input_3=w52) -> (Output_2=w53)
        w54 = default
        w55 = s3
        w56 = -1
        w57 = s5
        w58 = s6
        w59 = s7
        w60 = s8
      }
      frame "Finalize Complete" {
        $Finalized <- TRUE
        Property Node(instance in=reference to "Test Sequence", "Disabled"=FALSE)
        w53 = w52
        w54 = default
        w55 = s3
        w56 = s4
        w57 = s5
        w58 = s6
        w59 = s7
        w60 = s8
      }
      frame "Cancel" {
        Array Index(array=s6) -> (out0[s8]=w88)
        Property Node(instance in=w88, "Result"="Canceled") -> (instance out=w89)
        Replace Array Subset(inArray=s6, index=s8, new=w89) -> w90
        call "Handle Data Remaining in Queue.gviweb"(Input_3=reference to "Graph", Input_2=reference to "Step Status", Input_4=w9, Input_5=s8, Input=s5, Input_6=w90, Input_7=w52) -> (Output=w60, Output_3=w57, Output_4=w58, Output_2=w91)
        call "Report Step Complete.gviweb"(Manager Queue=w45, This Queue Name="UI", Step Name=w50, Input_3=w91) -> (Output_2=w53)
        w54 = default
        w55 = s3
        w56 = s4
        w59 = s7
      }
      frame "Cancel Complete" {
        w53 = w52
        w54 = default
        w55 = s3
        w56 = s4
        w57 = s5
        w58 = s6
        w59 = s7
        w60 = s8
      }
      frame "Exit" {
        Release Queue(queue=w49) -> (error out=w92)
        Release Queue(queue=w9) -> (error out=w93)
        Merge Errors(w52, w92, w93) -> (error out=w53)
        w54 = TRUE
        w55 = s3
        w56 = s4
        w57 = s5
        w58 = s6
        w59 = s7
        w60 = s8
      }
      frame Default {
        case (w48) {
          frame True {
            Wait(time to wait=500)
            call "Receive IO Data.gviweb"(Test data in=s5, Steps status in=s6, Step Index in=s8, error in=w52, IO Data Queue=w9) -> (Test data out=w57, Steps status out=w58, Step Index out=w60, error out=w53, Test Data for Graph=w94)
            $Graph <- w94
            call "Prep Step Staus for Display.gviweb"(Steps status out=w58) -> (Step Status=w95)
            $"Step Status" <- w95
          }
          frame False {
            call "Generate Undefined Message Error.gviweb"(Queue Name="UI", Message=w50, Error in=w52) -> (Error out=w53)
            w57 = s5
            w58 = s6
            w60 = s8
          }
        }
        w54 = default
        w55 = s3
        w56 = s4
        w59 = s7
      }
    }
    call "Handle Error.gviweb"(Input=w45, Input_2="UI", Output_2=w53) -> (Output_3=w96)
    next s3 = w55
    next s4 = w56
    next s5 = w57
    next s6 = w58
    next s7 = w59
    next s8 = w60
    stop if w54
  }
  Array Index(array=w6) -> (out0["Manager"]=w97)
  call "Define Program Instructions.gviweb"() -> (Instructions=w98, Instruction names=w99)
  s11 = uninitialised  # shift register
  while {
    # w6: Message Queues
    call "Dequeue Message.gvi"(message queue in=w97, error in=w7) -> (message queue out=w100, message=w101, message data=w102, error out=w103)
    # "Manager": Manager Queue Name
    # w3: Stop Event
    # s11: Manager Data
    # w98: Instructions
    # w99: Instruction Names
    case (w101) ignore case {  # Message Cases
      frame "SW Init" {
        w104 = w103
        w105 = default
        w106 = "Manager Data.gtype" {all zero or empty}
      }
      frame "Test Sequence Change" {
        Array Index(array=w6) -> (out0["UI"]=w107)
        call "Enqueue Message (Single).gvi"(message queue in=w107, message="Handle Test Change", message data=w102, error in=w103) -> (error out=w104)
        w105 = default
        w106 = s11
      }
      frame "Error" {
        Variant To Data(error in (no error)=w103, type="Error Data.gtype" {all zero or empty}, variant=w102) -> (data=w108, error out=w109)
        Property Node(instance in=w108) -> ("Error Origin"=w110, "Error In"=w111)
        Property Node(instance in=w111) -> ("code"=w112, "source"=w113)
        w114 = "================\nError\n\nAt: %s\n\nCode: %d\n%s\n================"
        Format Into String(formatString=w114, errIn=w109, w110, w112, w113) -> (outString=w115, errOut=w116)
        call "Append Log Text.gviweb"(Message Queues in=w6, Update Tex=w115, Error in=w116) -> (Error out_2=w104)
        w105 = default
        w106 = s11
      }
      frame "Exit Pressed" {
        # #development
        s12 = w103  # shift register
        for {
          w117 = each element of w6
          call "Enqueue Message (Single).gvi"(message queue in=w117, message="Exit", error in=s12) -> (error out=w118)
          next s12 = w118
        }
        w104 = s12
        w105 = default
        w106 = s11
      }
      frame "Exit" {
        Generate User Event(event data=TRUE, user event=w3) -> (error out=w119)
        Release Queue(queue=w100) -> (error out=w120)
        Merge Errors(w120, w119) -> (error out=w104)
        w105 = TRUE
        w106 = s11
      }
      frame Default {
        call "Generate Undefined Message Error.gviweb"(Queue Name="Manager", Message=w101, Error in=w103) -> (Error out=w104)
        w105 = default
        w106 = s11
      }
      frame "Instruction" {
        # w121: Instruction Name
        Variant To Data(error in (no error)=w103, type=w101, variant=w102) -> (data=w121, error out=w122)
        Search 1D Array(1D array=w99, element=w121) -> (index of element=w123)
        case (w123) {
          frame Default {
            Array Index(array=w98) -> (out0[w123]=w124)
            Property Node(instance in=w124) -> ("Init Info:Valid Starts"=w125, instance out=w126)
            Property Node(instance in=s11) -> ("Current State"=w127, instance out=w128)
            Search 1D Array(1D array=w125, element=w127) -> (index of element=w129)
            # Message in sequence start list -> ensure in valid start state
            case (w129) {
              frame Default {
                # In valid state for recieved message -> react
                Property Node(instance in=w126) -> ("Sequences"=w130)
                Format Into String(formatString="******************\nStart: %s\n******************", errIn=w122, w121) -> (outString=w131, errOut=w132)
                call "Append Log Text.gviweb"(Message Queues in=w6, Update Tex=w131, Error in=w132) -> (Message Queues out=w133, Error out_2=w134)
                call "Handle Next Sequence.gviweb"(Manager data in=w128, Sequences=w130, error in=w134, Message Queues=w133) -> (manager data out=w135, Sequence Steps=w136, End Instruction=w137, error out=w138, Message Queues out=w139)
                case (w137) {
                  frame True {
                    # #verify - new instruction, but sequences empty
                    w140 = "-------------------------------------\nInstruction Sequences Empty\n-------------------------------------"
                    call "Append Log Text.gviweb"(Message Queues in=w139, Update Tex=w140, Error in=w138) -> (Error out_2=w104)
                    w106 = w135
                  }
                  frame False {
                    Property Node(instance in=w135, "Current Instruction"=w121) -> (instance out=w141)
                    # Start first step in first sequence
                    call "Handle Next Step.gviweb"(Manager Data in=w141, Sequence Steps=w136, Error in=w138, Nessage Queues in=w139) -> (Manager Data out=w106, Error out=w104)
                  }
                }
              }
              frame -1 {
                w142 = """-------------------------------------
Received inavalid message for current status

Invalid Message: %s

State: %s
Currently waiting on: %s
-------------------------------------"""
                Property Node(instance in=w128) -> ("Current State"=w143, "Current Step:Message Queue"=w144)
                Format Into String(formatString=w142, errIn=w122, w121, w143, w144) -> (outString=w145, errOut=w146)
                call "Append Log Text.gviweb"(Message Queues in=w6, Update Tex=w145, Error in=w146) -> (Error out_2=w104)
                w106 = w128
              }
            }
          }
          frame -1 {
            # Instruction name missing from list -> undefined
            Format Into String(formatString="Instruction \"%s\" undefined.", w121) -> w147
            call "Build Error Cluster.gvi"(code=1, description=w147, error in=w122) -> (error out=w104)
            w106 = s11
          }
        }
        w105 = default
      }
      frame "Step Complete" {
        Property Node(instance in=s11) -> ("Current Step"=w148)
        Variant To Data(error in (no error)=w103, type=w148, variant=w102) -> (data=w149, error out=w150)
        Is Equal[ComparisonMode=CompareAggregates](x=w148, y=w149) -> w151
        case (w151) {
          frame False, Default {
            w152 = "Unexpected \"Step Complete\" message \n\nFrom: %s with action %s\nExpected: %s with action %s"
            Property Node(instance in=w149) -> ("Message Queue"=w153, "Action"=w154)
            Property Node(instance in=w148) -> ("Message Queue"=w155, "Action"=w156)
            Format Into String(formatString=w152, w153, w154, w155, w156) -> w157
            call "Append Log Text.gviweb"(Message Queues in=w6, Update Tex=w157, Error in=w150) -> (Error out_2=w104)
            w106 = s11
          }
          frame True {
            # Expected complete message received
            Property Node(instance in=s11) -> ("Remaining Steps"=w158, instance out=w159)
            Array Size(array=w158) -> (size(s)=w160)
            Property Node(instance in=w148) -> ("Message Queue"=w161, "Action"=w162)
            Format Into String(formatString="Completed %s %s", errIn=w150, w161, w162) -> (outString=w163, errOut=w164)
            call "Append Log Text.gviweb"(Message Queues in=w6, Update Tex=w163, Error in=w164) -> (Message Queues out=w165, Error out_2=w166)
            case (w160) {
              frame Default {
                # Steps remaining -> handle next step
                call "Handle Next Step.gviweb"(Manager Data in=w159, Sequence Steps=w158, Error in=w166, Nessage Queues in=w165) -> (Manager Data out=w106, Error out=w104)
              }
              frame 0 {
                Property Node(instance in=w159) -> ("Remaining Sequences"=w167, "Current State"=w168, instance out=w169)
                call "Send Sequence Complete UI Updates.gviweb"(Message queues in=w165, Current State=w168, Error In=w166) -> (Message queues out=w170, Error out=w171)
                call "Handle Next Sequence.gviweb"(Manager data in=w169, Sequences=w167, error in=w171, Message Queues=w170) -> (manager data out=w172, Sequence Steps=w173, End Instruction=w174, error out=w175, Message Queues out=w176)
                Property Node(instance in=w172) -> ("Current State"=w177, instance out=w178)
                # Sequence complete -> handle next sequence if it exists
                Format Into String(formatString="%s", errIn=w175, w177) -> (outString=w179, errOut=w180)
                call "Update Program Status.gviweb"(Message Queues in=w176, Status=w179, Error in=w180) -> (Message Queues out=w181, Error out=w182)
                case (w174) {
                  frame False, Default {
                    # Handle next step of next sequence
                    call "Handle Next Step.gviweb"(Manager Data in=w178, Sequence Steps=w173, Error in=w182, Nessage Queues in=w181) -> (Manager Data out=w106, Error out=w104)
                  }
                  frame True {
                    # No more sequences -> Instruction complete
                    Property Node(instance in=w178) -> ("Current Instruction"=w183, instance out=w106)
                    Format Into String(formatString="******************\nComplete: %s\n******************", errIn=w182, w183) -> (outString=w184, errOut=w185)
                    call "Append Log Text.gviweb"(Message Queues in=w181, Update Tex=w184, Error in=w185) -> (Error out_2=w104)
                  }
                }
              }
            }
          }
        }
        w105 = default
      }
    }
    call "Handle Error.gviweb"(Input=w100, Input_2="Manager", Output_2=w104) -> (Output_3=w186)
    next s11 = w106
    stop if w105
  }
  Register For Events("Stop Event"=w3) -> (event registration refnum out=w187)
  # #todo
  # create/ configure simulation cases/ flags
  # clean up
  # 	UI loop
  # 	IO loop
  # 	save all text log messages in same place
  Array Index(array=w6) -> (out0["Manager"]=w188)
  # Run Test Sequence example
  #
  # State: Idle
  #
  # Start Pressed
  #
  # Initialize
  # 	>> To UI ---Initialize
  # 	Waiting on UI
  # 	>> To IO ---Initialize
  # 	Waiting on IO
  # Execute
  # 	>> To UI ---Execute
  # 	Waiting on UI
  # 	>> To IO ---Execute
  # 	Waiting on IO
  # Finalize
  # 	>> To IO ---Finalize
  # 	Waiting on IO
  # 	>> To UI ---Finalize
  # 	Waiting on UI
  # Idle
  # This framework behind this sequencer operates by handling instructions (command lists) in the instruction case of the manager loop. The instruction will only begin if the manager is in a valid state to accept it. Instructions are initiated by sending an "Instruction" message via the manager's queue. The sequences in that instruction and their nested steps are then executed sequentially with the manager expecting a response to indicate each step's completion via the Report Step Complete VI. The manager will then continue on the to next step and next sequence as they're store in the sequences array. In each sequence element, a manager state name is defined. There's also a nested array containing the individual steps to be executed, each containing a message queue/ loop name and a message defining the action to be completed. The names of the step messages do not have to match the name of the manager state for that sequence.
  #
  # Instructions cannot be queued. There can only be one active at a time.
  #
  # Instruction names, start states and corresponding sequences are defined and stored in the Define Program Instructions VI, being made available to the manager at program start.
  s13 = w187  # shift register
  while {
    event (dynamic events = s13) {
      on "Test Start" Value changed {
        call "Enqueue Message (Single).gvi"(message queue in=w188, message="Instruction", message data="Run Test Sequence") -> (message queue out=w191, error out=w190)
        w189 = default
      }
      on "Cancel" Value changed {
        call "Enqueue Message (Single).gvi"(message queue in=w188, message="Instruction", message data="Cancel") -> (message queue out=w191, error out=w190)
        w189 = default
      }
      on "Exit (development only)" Value changed {
        call "Enqueue Message (Single).gvi"(priority message=TRUE, message queue in=w188, message="Exit Pressed") -> (message queue out=w191, error out=w190)
        w189 = default
      }
      on dynamic event 0 {
        # The Message Handling Loop processed an "Exit" message, which fired this event to stop the Event Handling Loop.
        w189 = TRUE
        w190 = default
        w191 = w188
      }
      on "Test Sequence" Value changed {
        Event Data() -> ("New Value"=w192)
        To Variant(anything=w192) -> w193
        call "Enqueue Message (Single).gvi"(message queue in=w188, message="Test Sequence Change", message data=w193) -> (message queue out=w191, error out=w190)
        w189 = default
      }
    }
    call "Error Handler - Event Handling Loop.gvi"(message queue in=w191, error in=w190) -> (dup error in=w194)
    stop if w189
  }
  Unregister For Events(error in=w194, event registration refnum=s13) -> (error out=w195)
  Merge Errors(w195, w186, w96, w44) -> (error out=w196)
  Destroy User Event(error in=w196, user event=w3)
